# Dynamo graph FloorFromFloor.dyn (Dynamo 2.3.0.5885)

file_path = Filename(".\RevitToDynamoToHypar.glb")
categories = Categories("OST_Floors")
all_elements_of_category = ElementsOfCategory(Category=categories)
convertRevitFloor = HyparDyn.Hypar.ConvertRevitFloor(incomingFloor=all_elements_of_category)
flatten = List.Flatten(list=convertRevitFloor)
modelFromElements = HyparDyn.Hypar.ModelFromElements(elements=flatten)
writeGlb = HyparDyn.Hypar.WriteGlb(filePath=file_path, model=modelFromElements)
